# Grasshopper definition robots_simulation.ghx (Grasshopper 1.0.8)
# plug-ins: RhinoCodePluginGH, Robots

list = RobotsLibrary(
    {"HVA-CRB15000", "HVA-IRB1200", "HVA-IRB2600", "HVA-IRB2600-positioner", "HVA-IRB2600-positioner_big_plate", "HVA-IRB4600", "HVA-IRB4600-track_left", "HVA-IRB4600-track_right", "IBOIS-IRB6400", "Swoosh ABB CRB15000-5", "Swoosh ABB IRB1300-1150"}, selected="HVA-IRB2600-positioner_big_plate",
    Type=0)
list_2 = RobotsLibrary(
    {"EduCell_Suction_Cup", "EduCell_Gripper_ON", "EduCell_Extruder", "Mill_Large", "Mill_Large_Zivid", "Mill_Large_Adapter", "Mill_Small", "Mill_Small_Extractor", "Suction_Double", "Suction_Spring", "Suction_Spring_Triple", "Gripper_Small_Flange", "Extruder", "ATC_Empty", "ATC_Calibration", "ATC_Mill", "ATC_Mill_Area", "ATC_Saw"}, selected="Mill_Large_Adapter",
    Type=1)
load_robot_system = LoadRobotSystem(Name=list, Base=PlaneXY(0, 0, 0))
load_tool = LoadTool(Name=list_2)
python_3_script = Python3Script(robots_tool=load_tool)  # -> out, targets
# ---------- python_3_script: Python ----------
#r: compas

from compas_rhino import DevTools
DevTools.enable_reloader()

import rapid_to_gh as rapid

data_dir = rapid.get_data_dir()

targets = rapid.create_gh_targets_from_rapid_file(data_dir / "test_movel_T_ROB1.mod")

for target in targets:
    rapid.set_tool(target, robots_tool)
# ---------- end python_3_script ----------
panel = Panel(python_3_script.targets)
create_program = CreateProgram(Name="DefaultProgram", RobotSystem=load_robot_system, Targets=python_3_script.targets, StepSize=1)  # -> Program, Code, Duration, Warnings, Errors
panel_2 = Panel(create_program.Warnings)
panel_3 = Panel(create_program.Errors)
program_simulation = ProgramSimulation(Program=create_program.Program, Time=Slider(0, range=0..1), Normalized=True)  # -> SystemMeshes, JointRotations, Plane, Index, Time, Program, Errors
